# Grasshopper definition amazing life vest.gh (Grasshopper 1.0.7)

number_slider = Slider(1.478, range=0..2)
int = Integer(0)
X = UnitX(Factor=Slider(5.896, range=0..20))
number_slider_2 = Slider(4.996, range=0..10)
number_slider_3 = Slider(2.736, range=0..10)
number_slider_4 = Slider(1.45, range=0..4)
pt = ConstructPoint(XCoordinate=number_slider_3, YCoordinate=number_slider_2, ZCoordinate=Slider(15, range=0..15))
pt_2 = ConstructPoint(XCoordinate=number_slider_3, YCoordinate=number_slider_2, ZCoordinate=Slider(0.25, range=0..10))
Z = UnitZ(Factor=Slider(11.374, range=0..15))
ln = Line(StartPoint=pt_2, EndPoint=pt)
cir = Circle(Plane=pt_2, Radius=number_slider_4)  # disabled
pipe = Pipe(Curve=ln, Radius=number_slider_4, Caps=0)
extr = Extrude(Base=pipe, Direction=Z)

pt_3 = ConstructPoint(XCoordinate=Slider(0, range=0..1), YCoordinate=Slider(10, range=0..10), ZCoordinate=Slider(4.876, range=0..10))
vec = VectorXYZ(XComponent=Slider(0, range=0..10), YComponent=Slider(4.202, range=0..10), ZComponent=Slider(21.123, range=0..40))  # -> Vector, Length
vec_2 = VectorXYZ(XComponent=Slider(0, range=0..1), YComponent=Slider(0, range=0..1), ZComponent=Slider(1, range=0..1))  # -> Vector, Length

addition = Addition(A=Slider(0, range=0..2), B=number_slider)

pt_4 = ConstructPoint(XCoordinate=Slider(0, range=0..1), YCoordinate=addition, ZCoordinate=Slider(0, range=0..1))
bzspan = BezierSpan(StartPoint=pt_4, StartTangent=vec.Vector, EndPoint=pt_3, EndTangent=vec_2.Vector)  # -> Curve, Length, Domain

panel = Panel(bzspan.Curve)

pt_5 = ConstructPoint(XCoordinate=Slider(0, range=0..1), YCoordinate=Slider(2.165, range=0..10), ZCoordinate=Slider(0, range=0..1))
vec_3 = VectorXYZ(XComponent=Slider(0, range=0..10), YComponent=Slider(3.537, range=0..10), ZComponent=Slider(14.286, range=0..40))  # -> Vector, Length
vec_4 = VectorXYZ(XComponent=Slider(0, range=0..1), YComponent=Slider(0, range=0..1), ZComponent=Slider(1, range=0..1))  # -> Vector, Length

addition_2 = Addition(A=number_slider, B=Slider(7.487, range=0..10))

pt_6 = ConstructPoint(XCoordinate=Slider(0, range=0..1), YCoordinate=addition_2, ZCoordinate=Slider(4.876, range=0..10))
bzspan_2 = BezierSpan(StartPoint=pt_5, StartTangent=vec_3.Vector, EndPoint=pt_6, EndTangent=vec_4.Vector)  # -> Curve, Length, Domain

ln_2 = Line(StartPoint=pt_4, EndPoint=pt_5)
ln_3 = Line(StartPoint=pt_3, EndPoint=pt_6)
ins = InsertItems(List=panel, Item=ln_2, Indices=int, Wrap=True)
ins_2 = InsertItems(List=ins, Item=ln_3, Indices=int, Wrap=True)
ins_3 = InsertItems(List=ins_2, Item=bzspan_2.Curve, Indices=int, Wrap=True)
panel_2 = Panel(ins_3)
edgesrf = EdgeSurface(CurveA=bzspan.Curve, CurveB=ln_2, CurveC=ln_3, CurveD=bzspan_2.Curve)
extr_2 = Extrude(Base=edgesrf, Direction=X)
sdiff = SolidDifference(BrepsA=extr_2, BrepsB=pipe)
preview = CustomPreview(Geometry=sdiff, Material=ColourSwatch(SwatchColor=RGB(191, 80, 0)))
